# Grasshopper definition CV_import.gh (Grasshopper 1.0.7)
# plug-ins: Human

# ---- group: DISPLAY COLORS
number_slider = Slider(0.9, range=0..1)
material = CreateMaterial(Diffuse="red", Specular=RGB(255, 255, 255), Emission=RGB(0, 0, 0), Transparency=number_slider, Shine=0)
material_2 = CreateMaterial(Diffuse="blue", Specular=RGB(255, 255, 255), Emission=RGB(0, 0, 0), Transparency=0, Shine=0)
material_3 = CreateMaterial(Diffuse="blue", Specular=RGB(255, 255, 255), Emission=RGB(0, 0, 0), Transparency=number_slider, Shine=0)
material_unloaded = Data(material)
material_unused = Data(material_2)
material_in_use = Data(material_3)

# ---- group: GLOBAL CONTROLS
control_curve_layer = Panel("REF")
bake_out_control_curves = Boolean(Button())
reset_control_curves = Boolean(Button())
control_curve_layer_2 = Text(control_curve_layer)

control_curve_layer_3 = Panel("Z LAYER")
z_steps = Slider(10, range=5..20)
generate_z_markers = Boolean(Toggle(True))
z_ref_pt = Point(<point referenced from the Rhino model>)
z_layer = Text(control_curve_layer_3)
z_steps_2 = Integer(z_steps)

# ---- group: PATH TO OUR DIRECTORY OF JSON FILES
path = FilePath("C:\Users\james\OneDrive\Documents\DEV\uk-workshop-analog-digital\session_data\Group 2_output\wood\")

path_2 = FilePath(path)

# ---- group: FINDS ALL FILES ENDING IN .JSON IN DIRECTORY
dir = DirectoryContents(FolderPath=path_2, Filter="*.json", IncludeSubfolders=False)  # -> FilePaths, FileNames

# ---- group: GRID LAYOUT PARAMETERS
row_height = Slider(200, range=100..1000)
column_width = Slider(500, range=100..1000)
row_length = Slider(4, range=1..10)
grid_origin = Point(<point referenced from the Rhino model>)

# ----
save_design = Boolean(Button())

# ---- group: CREATE INDEX NUMBER FOR EACH OBJECT
lng = ListLength(List=dir.FilePaths)
series = Series(Start=0, Step=1, Count=lng)

# ----
object_labels = Text(dir.FileNames)

# ---- group: READ JSON FILE AND CONVERT TO GH GEOMETRY
file = ReadFile(File=dir.FilePaths, PerLineParse=False)
python = GhPythonScript(input=file)  # -> out, flatten(bbox), flatten(contour), flatten(obj_length), flatten(obj_width), flatten(obj_height)
# ---------- python: Python ----------
__author__ = "james"
__version__ = "2019.04.11"

import rhinoscriptsyntax as rs
import Rhino.Geometry as rg
import json
import scriptcontext as sc

"""
SCRIPT CONTEXT DETERMINES WHERE GEOMETRY IS
GENERATED (TEMP GH GEO or BAKED RHINO GEO)
HERE WE WANT TO MAKE SURE IT'S SET TO GH
"""
sc.doc = ghdoc


# GLOBAL CONSTANTS

PIX2MM = 2.0 # CONVERSION FROM PIXELS TO REAL-WORLD MM
INVERT_Y = True # FLIP Y-AXIS DIRECTION TO MATCH OPENCV

# READ DATA FROM JSON
data = json.loads(input)


# UTILITY FUNCTIONS TO CONVERT TO RHINO GEOMETRY
def make_point(p):
    """
    APPLY CONVERSION FACTOR TO EACH INPUT POINT COORDINATE
    AND RETURN RHINO POINT OBJECT
    """
    x = p[0] / PIX2MM
    y = p[1] / PIX2MM
    if INVERT_Y:
        y = -y
    return rs.AddPoint(x, y, 0)

def make_polyline(points):
    """
    CONVERT LIST OF COORDINATES TO RHINO POINTS
    APPEND FIRST ITEM TO END OF LIST TO MAKE CLOSED POLYLINE
    AND RETURN A RHINO POLYLINE OBJECT"""
    pts = [make_point(p) for p in points]
    pts.append(pts[0])
    return rs.AddPolyline(pts)


# EXTRACT THE BOUNDING BOX DIMENSIONS FROM DATA FILE
obj_length = data["length"] / PIX2MM
obj_width = data["width"] / PIX2MM
obj_height = data["depth"] / PIX2MM

# TRANSLATION (MOVE) TO CENTER ON ORIGIN
xform_move = rs.XformTranslation( [-obj_length / 2.0, -obj_width / 2.0, 0] )
# XY ROTATION TO MAKE ALL ORIENTATIONS MATCH
rotate = 0 if obj_length > obj_width else 90
xform_rotate = rs.XformRotation2(rotate, [0,0,1], [0,0,0])

# CREATE RHINO RECTANGLE
origin = rs.PlaneTransform(rs.WorldXYPlane(), xform_move)
origin = rs.PlaneTransform(origin, xform_rotate)
bbox = rs.AddRectangle(origin, obj_length, obj_width)


# EXTRACT POSITION DATA FROM DATA FILE
obj_cx = data["cx"] / PIX2MM
obj_cy = data["cy"] / PIX2MM
if INVERT_Y:
    obj_cy = -obj_cy
obj_rotation = data["rotation"]

# TRANSLATION TO CENTER CONTOUR ON ORIGIN
xform_move = rs.XformTranslation( [-obj_cx, -obj_cy, 0] )
# ROTATION TO ALIGN WITH AXES AND MATCH BOUNDING BOX
xform_rotate = rs.XformRotation2(rotate+obj_rotation, [0,0,1], [0,0,0])

# EXTRACT EDGE CONTOUR FROM DATA FILE
contour = make_polyline( data["boundary"] )
contour = rs.TransformObject(contour, xform_move)
contour = rs.TransformObject(contour, xform_rotate)
# ---------- end python ----------

# ----
bnd = Bounds(Numbers=python.obj_height)

# ---- group: COMPUTE COLUMN POSITION
mod = Modulus(A=series, B=row_length)
multiplication = Multiplication(A=column_width, B=mod)
X = UnitX(Factor=multiplication)

# ---- group: COMPUTE ROW POSITION
division = Division(A=series, B=row_length)
round = Round(Number=division)  # -> Nearest, Floor, Ceiling
multiplication_2 = Multiplication(A=row_height, B=round.Floor)
Y = UnitY(Factor=multiplication_2)

# ----
z_layer_2 = Text(z_layer)

# ---- group: CREATE REF LAYER IF DOESN'T EXIST
control_curve_layer_4 = Text(control_curve_layer_2)
layers = CreateModifyLayers(LayerName=[control_curve_layer_4, z_layer_2], DeleteLayer=False, enableFullPath=False)  # -> LayerNames, LayerFullPath

# ---- group: DELETE Z-POINTS
bake_out_control_curves_2 = Boolean(bake_out_control_curves)
generate_z_markers_2 = Boolean(generate_z_markers)
z_layer_3 = Text(z_layer)
and = GateAnd(A=bake_out_control_curves_2, B=generate_z_markers_2)
python_2 = GhPythonScript(reset=and, layer=z_layer_3)  # inputs layer: list
# ---------- python_2: Python ----------
__author__ = "james"
__version__ = "2019.04.13"

import rhinoscriptsyntax as rs
import scriptcontext as sc
import Rhino

rhdoc = Rhino.RhinoDoc.ActiveDoc

if reset:
    sc.doc = rhdoc
    for lyr in layer:
        objs = rs.ObjectsByLayer(lyr)
        rs.DeleteObjects(objs)

sc.doc = ghdoc
# ---------- end python_2 ----------

# ---- group: RESET: DELETES ALL CONTROL CURVES
reset_control_curves_2 = Boolean(reset_control_curves)
control_curve_layer_5 = Text(control_curve_layer_2)
z_layer_4 = Text(z_layer)
python_3 = GhPythonScript(reset=reset_control_curves_2, layer=[control_curve_layer_5, z_layer_4])  # inputs layer: list; same code as python_2

# ----
dedomain = DeconstructDomain(Domain=bnd)  # -> Start, End
max_height = Number(dedomain.End)

# ---- group: CLEAN-UP CONTOUR POLYLINES
redpline = Reduce(Polyline=python.contour, Tolerance=Slider(0.75, range=0.001..1))  # -> Polyline, Reduction

# ----
grid_origin_2 = Point(grid_origin)

# ---- group: CREATE MOVEMENT VECTOR TO GRID POS
addition = Addition(A=X, B=Y, C=grid_origin_2)
vec = Vector(addition)

# ---- group: GET BAKED CONTROL CURVES FROM LAYER
control_curve_layer_6 = Text(control_curve_layer_2)
dpipeline = DynamicGeometryPipeline(
    LayerFilter=control_curve_layer_6,
    TypeFilter="Curve",
    NameFilter="*",
    GroupByLayer=False,
    GroupByType=False,
    IncludeHidden=True,
    IncludeLocked=True,
    enableFullPath=False,
    listenToAttributes=True)
cp = ControlPoints(Curve=dpipeline)  # -> Points, Weights, Knots
objatts = ObjectAttributes(ObjectOrAttributes=dpipeline)  # -> Name, LayerName, LayerFullPath, Color, MaterialName, LinetypeName, GroupIndices, PlotWeight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
item = ListItem(List=cp.Points, Index="2", Wrap=True)
item_2 = ListItem(List=cp.Points, Index="1", Wrap=True)
item_3 = ListItem(List=cp.Points, Index="0", Wrap=True)
pl_3pt = Plane3Pt(PointA=item_2, PointB=item_3, PointC=item)  # -> flatten(Plane)
rhino_curve_label = Text(objatts.Name)
rh_curve_orient = Plane(pl_3pt)
rh_curve = Curve(dpipeline)

# ---- group: MOVE OBJECT TO GRID POSITION
move = Move(Geometry=python.bbox, Motion=vec)  # -> Geometry, Transform
move_2 = Move(Geometry=redpline.Polyline, Motion=vec)  # -> Geometry, Transform
object_contour = Curve(move_2.Geometry)
bounding_rect = Rectangle(move.Geometry)

# ---- group: EXTRUDE BOUNDARY TO SOLID OBJECT
boundary = BoundarySurfaces(Edges=graft(object_contour))
Z = UnitZ(Factor=python.obj_height)
item_4 = ListItem(List=boundary, Index=0, Wrap=True)  # -> flatten(Item)
extr = Extrude(Base=simplify(item_4), Direction=simplify(Z))
cap = CapHoles(Brep=extr)
shape_grid = Brep(cap)

# ----
rh_curve_2 = Curve(dpipeline)

# ---- group: IS CONTROL CURVE BAKED OUT?
rhino_curve_label_2 = Text(rhino_curve_label)
gh_object_labels = Text(object_labels)
mindex = MemberIndex(Set=rhino_curve_label_2, Member=gh_object_labels)  # -> Index, Count
control_curve_is_baked = Boolean(mindex.Count)

# ----
control_curve_is_baked_2 = Boolean(control_curve_is_baked)
gh_object_labels_2 = Text(object_labels)
bounding_rect_2 = Rectangle(bounding_rect)
dispatch = Dispatch(List=bounding_rect_2, DispatchPattern=control_curve_is_baked_2)  # -> ListA, ListB
dispatch_2 = Dispatch(List=gh_object_labels_2, DispatchPattern=control_curve_is_baked_2)  # -> ListA, ListB
curve_not_in_model = Curve(dispatch.ListB)
tag_not_in_model = Text(dispatch_2.ListB)
curve_in_model = Curve(dispatch.ListA)
tag_in_model = Text(dispatch_2.ListA)

# ---- group: ORIENTATION OF MODEL OBJECTS
curve_in_model_2 = Curve(dispatch.ListA)
cp_2 = ControlPoints(Curve=curve_in_model_2)  # -> Points, Weights, Knots
item_5 = ListItem(List=cp_2.Points, Index="2", Wrap=True)
item_6 = ListItem(List=cp_2.Points, Index="1", Wrap=True)
item_7 = ListItem(List=cp_2.Points, Index="0", Wrap=True)
pl_3pt_2 = Plane3Pt(PointA=item_6, PointB=item_7, PointC=item_5)  # -> flatten(Plane)
gh_curve_orient = Plane(pl_3pt_2)

# ---- group: IS CONTROL CURVE AT START POSITION?
rhino_curve_label_3 = Text(rhino_curve_label)
rh_curve_orient_2 = Plane(rh_curve_orient)
gh_object_labels_3 = Text(object_labels)
gh_curve_orient_2 = Plane(gh_curve_orient)
keysearch = KeyValueSearch(Keys=rhino_curve_label_3, Values=rh_curve_orient_2, Search=gh_object_labels_3)
dist = Distance(PointA=keysearch, PointB=gh_curve_orient_2)
null = NullItem(Item=dist)  # -> NullFlags, InvalidFlags, Description
larger = LargerThan(FirstNumber=dist, SecondNumber="0.0001")  # -> LargerThan, OrEqualTo
or = GateOr(A=null.NullFlags, B=larger.LargerThan)
control_curve_is_moved = Boolean(or)

# ---- group: IS CONTROL CURVE PLACED?
control_curve_is_baked_3 = Boolean(control_curve_is_baked)
control_curve_is_moved_2 = Boolean(control_curve_is_moved)
and_2 = GateAnd(A=control_curve_is_baked_3, B=control_curve_is_moved_2)
addition_2 = Addition(A=control_curve_is_baked_3, B=and_2)
control_curve_is_placed = Boolean(and_2)
placement_state = Integer(addition_2)

# ---- group: VISUALIZE PLACED OBJECT
rhino_curve_label_4 = Text(rhino_curve_label)
rh_curve_orient_3 = Plane(rh_curve_orient)
gh_curve_orient_3 = Plane(gh_curve_orient)
gh_object_labels_4 = Text(object_labels)
control_curve_is_placed_2 = Boolean(control_curve_is_placed)
shape_grid_2 = Brep(shape_grid)
dispatch_3 = Dispatch(List=gh_object_labels_4, DispatchPattern=control_curve_is_placed_2)  # -> ListA, ListB
keysearch_2 = KeyValueSearch(Keys=rhino_curve_label_4, Values=rh_curve_orient_3, Search=dispatch_3.ListA)
keysearch_3 = KeyValueSearch(Keys=gh_object_labels_4, Values=gh_curve_orient_3, Search=dispatch_3.ListA)
keysearch_4 = KeyValueSearch(Keys=gh_object_labels_4, Values=shape_grid_2, Search=dispatch_3.ListA)
orient = Orient(Geometry=keysearch_4, Source=keysearch_3, Target=keysearch_2)  # -> Geometry, Transform
preview = CustomPreview(Geometry=orient.Geometry, Material="gray")

# ---- group: SELECT VISUALIZATION COLOR BY STATE
material_unloaded_2 = Data(material_unloaded)
material_unused_2 = Data(material_unused)
material_in_use_2 = Data(material_in_use)
merge = Merge(Data1=material_unloaded_2, Data2=material_unused_2, Data3=material_in_use_2)
item_8 = ListItem(List=merge, Index=placement_state, Wrap=True)
material_per_object = Data(item_8)
shape_grid_3 = Brep(shape_grid)
preview_2 = CustomPreview(Geometry=shape_grid_3, Material=material_per_object)

# ----
rh_curve_3 = Curve(rh_curve)
keysearch_5 = KeyValueSearch(Keys=rhino_curve_label_4, Values=rh_curve_3, Search=dispatch_3.ListA)
placed_orient_curve = Curve(keysearch_5)
placed_labels = Text(dispatch_3.ListA)
placed_brick = Brep(orient.Geometry)
reset_control_curves_3 = Boolean(reset_control_curves)
save_design_2 = Boolean(save_design)

# ---- group: BAKE CONTROL CURVES
bake_out_control_curves_3 = Boolean(bake_out_control_curves)
curve_not_in_model_2 = Curve(curve_not_in_model)
tag_not_in_model_2 = Text(tag_not_in_model)
control_curve_layer_7 = Text(control_curve_layer_2)
createatts = CreateAttributes(Name=tag_not_in_model_2, LayerName=control_curve_layer_7, enableFullPath=False)
bake = BakeGeometry(
    Bake=bake_out_control_curves_3,
    Geometry=curve_not_in_model_2,
    Attributes=createatts,
    DeleteOldBakes=False,
    PreserveTrees=False)

# ----
bake_out_control_curves_4 = Boolean(bake_out_control_curves)
generate_z_markers_3 = Boolean(generate_z_markers)
z_layer_5 = Text(z_layer)
z_ref_pt_2 = Point(z_ref_pt)
z_steps_3 = Integer(z_steps_2)
max_height_2 = Number(max_height)
series_2 = Series(Start=0, Step=max_height_2, Count=z_steps_3)
and_3 = GateAnd(A=bake_out_control_curves_4, B=generate_z_markers_3)
Z_2 = UnitZ(Factor=series_2)
move_3 = Move(Geometry=z_ref_pt_2, Motion=Z_2)  # -> Geometry, Transform
createatts_2 = CreateAttributes(LayerName=z_layer_5, enableFullPath=False)
bake_2 = BakeGeometry(Bake=and_3, Geometry=move_3.Geometry, Attributes=createatts_2, DeleteOldBakes=False, PreserveTrees=False)

or_2 = GateOr(A=save_design_2, B=reset_control_curves_3)
layertable = LayerTable(Update=or_2, AutoUpdate=False)  # -> Layers, FullLayerPaths, LayerColors, Linetypes, MaterialNames, Visible, PrintWidth, PrintColor
python_4 = GhPythonScript(prefix="design_", layers=layertable.Layers)  # -> out, next_layer; inputs layers: list
# ---------- python_4: Python ----------
import rhinoscriptsyntax as rs
import scriptcontext as sc
import Rhino

rhdoc = Rhino.RhinoDoc.ActiveDoc

sc.doc = rhdoc

des_layers = [l for l in layers if prefix in l]



des_layers = sorted(des_layers, key=lambda x: int(x.split("_")[-1]))

if len(rs.ObjectsByLayer(des_layers[-1])) > 0:
    next_layer = "{}{:03d}".format(prefix, len(des_layers))
else:
    next_layer = des_layers[-1]

sc.doc = ghdoc
# ---------- end python_4 ----------
placed_labels_2 = Text(placed_labels)
orient_curves_placed = Curve(placed_orient_curve)
layers_2 = CreateModifyLayers(LayerName="design_000", DeleteLayer=False, enableFullPath=False)  # -> LayerNames, LayerFullPath
save_design_3 = Boolean(save_design_2)
layers_3 = CreateModifyLayers(LayerName=python_4.next_layer, DeleteLayer=False, enableFullPath=False)  # -> LayerNames, LayerFullPath
createatts_3 = CreateAttributes(Name=placed_labels_2, LayerName=layers_3.LayerNames, enableFullPath=False)
bake_3 = BakeGeometry(Bake=save_design_3, Geometry=placed_brick, Attributes=createatts_3, DeleteOldBakes=False, PreserveTrees=False)
bake_4 = BakeGeometry(Bake=save_design_3, Geometry=orient_curves_placed, Attributes=createatts_3, DeleteOldBakes=False, PreserveTrees=False)
